# Grasshopper definition diamond_sku.gh (Grasshopper 1.0.7)

# ---- group: RH_IN:path
path = FilePath("C:\Dummy\J0135143371-1-14KY-25ga-Ariana.dxf")

# ----
panel = Panel(path)

_3dm = Import3DM(File=panel, Layer="*", Name="*")
crv = Curve(_3dm)

list = ValueList({"Yellow Gold": 0, "Rose Gold": 1, "White Gold": 2, "Silver": 3}, selected="Yellow Gold")
pt = Point(Point(0, 0, 0))

runion = RegionUnion(Curves=crv)
area = Area(Geometry=runion)  # -> Area, Centroid
pt_2 = Point(area.Centroid)
ln = Line(StartPoint=pt_2, EndPoint=pt)
move = Move(Geometry=crv, Motion=ln)  # -> flatten(Geometry), Transform

# ---- group: RH_IN:number
int = Integer(list)

# ----
geo = Geometry(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)
srf = Surface(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)
debrep = DeconstructBrep(Brep=geo)  # -> Faces, Edges, Vertices
srfsplit = SurfaceSplit(Surface=srf, Curves=move.Geometry)
amoments = AreaMoments(Geometry=srfsplit)  # -> Area, Centroid, Inertia, InertiaError, Secondary, SecondaryError, Gyration
pt_3 = Point(debrep.Vertices)
number_slider = Slider(0.1, range=0..1)
cp = ClosestPoint(Point=pt, Cloud=amoments.Centroid)  # -> ClosestPoint, CPIndex, Distance
item = ListItem(List=srfsplit, Index=cp.CPIndex, Wrap=True)
item_2 = ListItem(List=pt_3, Index=Slider(26, range=0..100), Wrap=True)
num = Number(0.09)
scale_nu = ScaleNU(Geometry=item, Plane=PlaneXY(0, 0, 0), ScaleX=number_slider, ScaleY=number_slider, ScaleZ=1)  # -> Geometry, Transform
num_2 = Number(0.128)
debrep_2 = DeconstructBrep(Brep=scale_nu.Geometry)  # -> Faces, Edges, Vertices
filter = StreamFilter(Gate=int, Stream0=num, Stream1=num, Stream2=num, Stream3=num_2)
amoments_2 = AreaMoments(Geometry=debrep_2.Edges)  # -> Area, Centroid, Inertia, InertiaError, Secondary, SecondaryError, Gyration
cp_2 = ClosestPoint(Point=item_2, Cloud=amoments_2.Centroid)  # -> ClosestPoint, CPIndex, Distance
Z = UnitZ(Factor=filter)
geo_2 = Geometry(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)
ln_2 = Line(StartPoint=item_2, EndPoint=cp_2.ClosestPoint)
extr = Extrude(Base=scale_nu.Geometry, Direction=Z)
move_2 = Move(Geometry=geo, Motion=ln_2)  # -> Geometry, Transform
move_3 = Move(Geometry=geo_2, Motion=ln_2)  # -> Geometry, Transform
mesh = Mesh(extr)
mesh_2 = Mesh(move_2.Geometry)
merge = Merge(Data1=mesh, Data2=mesh_2)
munion = MeshUnion(Meshes=merge)

# ---- group: RH_OUT:mesh_gem
mesh_3 = Mesh(move_3.Geometry)

# ---- group: RH_OUT:mesh
mesh_4 = Mesh(munion)
