# Grasshopper definition nameplate_definition_v2_signpainter.gh (Grasshopper 1.0.7)

# ---- group: RH_IN:path
txt = Text("C:\Dummy\JWLN0300.dxf")

# ----
panel = Panel(txt)

_3dm = Import3DM(File=panel, Layer="*", Name="*")
crv = Curve(_3dm)

simplify = SimplifyCurve(Curve=crv)  # -> Curve, Simplified
list = ValueList({"Yellow Gold": 0, "Rose Gold": 1, "White Gold": 2, "Silver": 3}, selected="Rose Gold")
pt = Point(Point(0, 0, 0))

runion = RegionUnion(Curves=crv)
area = Area(Geometry=runion)  # -> Area, Centroid
pt_2 = Point(area.Centroid)
ln = Line(StartPoint=pt_2, EndPoint=pt)

num = Number(0.08751)
move = Move(Geometry=simplify.Curve, Motion=ln)  # -> Geometry, Transform
num_2 = Number(0.12)

# ---- group: RH_IN:number
int = Integer(list)

# ----
filter = StreamFilter(Gate=int, Stream0=num, Stream1=num, Stream2=num, Stream3=num_2)
num_3 = Number(1)
Z = UnitZ(Factor=filter)
extr = Extrude(Base=move.Geometry, Direction=Z)
cap = CapHoles(Brep=extr)
lng = ListLength(List=cap)
subtraction = Subtraction(A=lng, B=num_3)
item = ListItem(List=cap, Index=0, Wrap=True)
dom = ConstructDomain(DomainStart=num_3, DomainEnd=subtraction)
subset = SubList(List=cap, Domain=dom, Wrap=True)  # -> List, Index
sdiff = SolidDifference(BrepsA=item, BrepsB=subset.List)
trim = TrimSolid(Shape=item, Cutters=subset.List)
number_slider = Slider(0.1, range=0..1)
scale_nu = ScaleNU(Geometry=sdiff, Plane=PlaneXY(0, 0, 0), ScaleX=number_slider, ScaleY=number_slider, ScaleZ=1)  # -> Geometry, Transform
mesh = MeshBrep(
    Brep=scale_nu.Geometry,
    Settings={GridMaxCount=0, GridMinCount=16, JaggedSeams=False, MaxEdgeLength=0, MinEdgeLength=0.0001, MinTolerance=0, Refine=True, RefineAngle=0, RelativeTolerance=0.65, SimplePlanes=True, Tolerance=0})  # -> simplify(Mesh)

# ---- group: RH_OUT:mesh
mesh_2 = Mesh(mesh)
